% Simulink data dictionary Adaptive_Cruise_Control.sldd

CameraInput_LeadVehicle = Simulink.Signal(StorageClass="ImportedExtern", DataType="uint8", Min=0, Max=255)
RadarInput_LeadVehicle = Simulink.Signal(StorageClass="ImportedExtern", DataType="uint8", Min=0, Max=255)
CameraInput_DriveVehicle = Simulink.Signal(StorageClass="ImportedExtern", DataType="uint8", Min=0, Max=255)
RadarInput_DriveVehicle = Simulink.Signal(StorageClass="ImportedExtern", DataType="uint8", Min=0, Max=255)
Time_Gap = Simulink.Signal(StorageClass="ImportedExtern", DataType="uint8", Min=0, Max=255)
Set_Gap = Simulink.Signal(StorageClass="ImportedExtern", DataType="uint8", Min=0, Max=255)
Set_Speed = Simulink.Signal(StorageClass="ImportedExtern", DataType="uint8", Min=0, Max=255)
SetSwitch = Simulink.Signal(StorageClass="ImportedExtern", DataType="boolean", Min=0, Max=1)
CruiseSwitch = Simulink.Signal(StorageClass="ImportedExtern", DataType="boolean", Min=0, Max=1)
DriveVehicle_Speed = Simulink.Signal(StorageClass="ExportToFile", DataType="uint8", Min=0, Max=255)
LeadVehicle_Detected = Simulink.Signal(StorageClass="ExportToFile", DataType="uint8", Min=0, Max=255)
LeadVehicle_Speed = Simulink.Signal(StorageClass="ExportToFile", DataType="uint8", Min=0, Max=255)
Acceleration_Mode = Simulink.Signal(StorageClass="ExportToFile", DataType="uint8", Min=0, Max=255)