% Requirement links of Adaptive_Cruise_Control.slx (R2019a)

block :1 implements https://d.docs.live.net/487f5580de997f3a/Adaptive_Cruise_Control .docx#@Simulink_requirement_item_1: Requirement 1– Lead Vehicle:
block :11 implements https://d.docs.live.net/487f5580de997f3a/Adaptive_Cruise_Control .docx#@Simulink_requirement_item_2: Requirement 2 – Drive Vehicle:
block :26 implements https://d.docs.live.net/487f5580de997f3a/Adaptive_Cruise_Control .docx#@Simulink_requirement_item_12: Requirement 3 – Adaptive Cruise Control Algorithm:
block :26:10 implements https://d.docs.live.net/487f5580de997f3a/Adaptive_Cruise_Control .docx#@Simulink_requirement_item_3: Requirement 3a – ACC OFF MODE state logic:
block :26:12 implements https://d.docs.live.net/487f5580de997f3a/Adaptive_Cruise_Control .docx#@Simulink_requirement_item_4: Requirement 3b – ACC STANDBY MODE state logic:
block :26:47 implements https://d.docs.live.net/487f5580de997f3a/Adaptive_Cruise_Control .docx#@Simulink_requirement_item_6: Requirement 3c (i) – LeadVehicle_Detected_Follow (ACC ON MODE):
block :26:49 implements https://d.docs.live.net/487f5580de997f3a/Adaptive_Cruise_Control .docx#@Simulink_requirement_item_7: Requirement 3c (ii) – LeadVehicle_Not_Detected (ACC ON MODE):
block :26:53 implements https://d.docs.live.net/487f5580de997f3a/Adaptive_Cruise_Control .docx#@Simulink_requirement_item_10: Requirement 3c (v) - LeadVehicle_Speed_lessthan_Set_Speed (ACC ON MODE):
block :26:60 implements https://d.docs.live.net/487f5580de997f3a/Adaptive_Cruise_Control .docx#@Simulink_requirement_item_8: Requirement 3c (iii) – LeadVehicle_Detected_Resume (ACC ON MODE):
block :26:62 implements https://d.docs.live.net/487f5580de997f3a/Adaptive_Cruise_Control .docx#@Simulink_requirement_item_11: Requirement 3c (vi) - LeadVehicle_Speed_equal_Set_Speed (ACC ON MODE):
block :26:68 implements https://d.docs.live.net/487f5580de997f3a/Adaptive_Cruise_Control .docx#@Simulink_requirement_item_9: Requirement 3c (iv) - LeadVehicle_Not_Detected_Resume (ACC ON MODE):
block :26:81 implements https://d.docs.live.net/487f5580de997f3a/Adaptive_Cruise_Control .docx#@Simulink_requirement_item_5: Requirement 3c – ACC ON MODE state logic:
block :26:86 implements https://d.docs.live.net/487f5580de997f3a/Adaptive_Cruise_Control .docx#@Simulink_requirement_item_9: Requirement 3c (iv) - LeadVehicle_Not_Detected_Resume (ACC ON MODE):
block :26:89 implements https://d.docs.live.net/487f5580de997f3a/Adaptive_Cruise_Control .docx#@Simulink_requirement_item_9: Requirement 3c (iv) - LeadVehicle_Not_Detected_Resume (ACC ON MODE):
block :48:10 implements https://d.docs.live.net/487f5580de997f3a/Adaptive_Cruise_Control .docx#@Simulink_requirement_item_3: Requirement 3a – ACC OFF MODE state logic:
block :48:12 implements https://d.docs.live.net/487f5580de997f3a/Adaptive_Cruise_Control .docx#@Simulink_requirement_item_4: Requirement 3b – ACC STANDBY MODE state logic:
block :48:47 implements https://d.docs.live.net/487f5580de997f3a/Adaptive_Cruise_Control .docx#@Simulink_requirement_item_6: Requirement 3c (i) – LeadVehicle_Detected_Follow (ACC ON MODE):
block :48:49 implements https://d.docs.live.net/487f5580de997f3a/Adaptive_Cruise_Control .docx#@Simulink_requirement_item_7: Requirement 3c (ii) – LeadVehicle_Not_Detected (ACC ON MODE):
block :48:53 implements https://d.docs.live.net/487f5580de997f3a/Adaptive_Cruise_Control .docx#@Simulink_requirement_item_10: Requirement 3c (v) - LeadVehicle_Speed_lessthan_Set_Speed (ACC ON MODE):
block :48:60 implements https://d.docs.live.net/487f5580de997f3a/Adaptive_Cruise_Control .docx#@Simulink_requirement_item_8: Requirement 3c (iii) – LeadVehicle_Detected_Resume (ACC ON MODE):
block :48:62 implements https://d.docs.live.net/487f5580de997f3a/Adaptive_Cruise_Control .docx#@Simulink_requirement_item_11: Requirement 3c (vi) - LeadVehicle_Speed_equal_Set_Speed (ACC ON MODE):
block :48:68 implements https://d.docs.live.net/487f5580de997f3a/Adaptive_Cruise_Control .docx#@Simulink_requirement_item_9: Requirement 3c (iv) - LeadVehicle_Not_Detected_Resume (ACC ON MODE):
block :48:81 implements https://d.docs.live.net/487f5580de997f3a/Adaptive_Cruise_Control .docx#@Simulink_requirement_item_5: Requirement 3c – ACC ON MODE state logic: